% Simulink data dictionary MotorControlParameters.sldd

PMSM_Rs = Simulink.Parameter(0.02125)
PMSM_p = Simulink.Parameter(14)
Vdc = Simulink.Parameter(35)
Imax = Simulink.Parameter(15)
PMSM_Ls = Simulink.Parameter(1.7475e-5)
PMSM_psiPM = Simulink.Parameter(0.002165)
PMSM_J = Simulink.Parameter(0.000129)
PMSM_B = Simulink.Parameter(0.000861)